# Grasshopper definition Project.gh (Grasshopper 1.0.8)
# plug-ins: Karamba3D, Octopus

# ---- group: Legacy Genes (unused)
h_innen = ConstructDomain(DomainStart="1", DomainEnd="5")
width_ratio = ConstructDomain(DomainStart="0.7", DomainEnd="1")

# ---- group: INPUT
gene_pool = GenePool(Decimals=2, Maximum=1, Minimum=0, Value=[0, 0, 0.44, 0.18])
surface = Surface(reparameterize(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))
x_segments = ConstructDomain(DomainStart="2", DomainEnd="5")
y_segments = ConstructDomain(DomainStart="3", DomainEnd="8")
h_aussen = ConstructDomain(DomainStart="2", DomainEnd="4")
cross_section = ConstructDomain(DomainStart="0", DomainEnd="11")

# ----
merge = Merge(Data1=x_segments, Data2=y_segments, Data3=h_aussen, Data4=cross_section)
unit_z = UnitZ(Factor="10")
remap_numbers = RemapNumbers(Value=gene_pool, Source=Domain(0, 1), Target=merge)  # -> Mapped, Clipped
move = Move(Geometry=surface, Motion=unit_z)  # -> flatten(Geometry), Transform
list_item = ListItem(List=remap_numbers.Mapped, Index=0, Wrap=True)  # -> Item, Item1, Item2, Item3
width_ratio_2 = Number(Slider(1, range=0..1))
X = Integer(expr("x*4", list_item.Item))
Y = Integer(expr("x*2", list_item.Item1))
h_aussen_2 = Number(list_item.Item2)
cross_section_idx = Integer(list_item.Item3)
scale_nu = ScaleNU(Geometry=move.Geometry, Plane=PlaneXY(0, 0, 0), ScaleX=width_ratio_2, ScaleY=1, ScaleZ=1)  # -> Geometry, Transform
h_innen_2 = Slider(2, range=0..3)
h_h_ratio = Expression(H_aussen=h_aussen_2, h_innen=h_innen_2, Expression="H_aussen/h_innen")
divide_surface = DivideSurface(Surface=reparameterize(scale_nu.Geometry), UCount=X, VCount=Y)  # -> simplify(Points), Normals, Parameters
cluster = Cluster_2(geometry=scale_nu.Geometry, X=X, Y=Y, h_aussen=h_aussen_2, h_innen=h_innen_2)

# ---- group: Goals
height_ratio = Number(h_h_ratio)

# ---- group: Truss assembly
tree_statistics = TreeStatistics(Tree=divide_surface.Points)  # -> Paths, Length, Count
tree_statistics_2 = TreeStatistics(Tree=divide_surface.Points)  # -> Paths, Length, Count
flip_matrix = FlipMatrix(Data=cluster)
cull_index = CullIndex(List=tree_statistics.Paths, Indices="-1", Wrap=True)
cull_index_2 = CullIndex(List=tree_statistics_2.Paths, Indices="0", Wrap=True)
polyline = PolyLine(Vertices=flip_matrix, Closed=False)
tree_branch = TreeBranch(Tree=divide_surface.Points, Path=cull_index_2, MaintainPaths=True)
tree_branch_2 = TreeBranch(Tree=divide_surface.Points, Path=cull_index, MaintainPaths=True)
explode = Explode(Curve=polyline, Recursive=True)  # -> Segments, Vertices
list_length = ListLength(List=explode.Segments)
weave = Weave(Pattern=[0, 1], Stream0=tree_branch_2, Stream1=cluster, NullGaps=False)  # -> simplify(Weave)
weave_2 = Weave(Pattern=[0, 1], Stream0=tree_branch, Stream1=cluster, NullGaps=False)  # -> simplify(Weave)
flip_matrix_2 = FlipMatrix(Data=divide_surface.Points)
division = Division(A=list_length, B="2")
round = Round(Number=division)  # -> Nearest, Floor, Ceiling
polyline_2 = PolyLine(Vertices=weave, Closed=False)
polyline_3 = PolyLine(Vertices=weave_2, Closed=False)
polyline_4 = PolyLine(Vertices=cluster, Closed=False)
polyline_5 = PolyLine(Vertices=flip_matrix_2, Closed=False)
polyline_6 = PolyLine(Vertices=divide_surface.Points, Closed=False)
cull_index_3 = CullIndex(List=explode.Segments, Indices=round.Floor, Wrap=True)
explode_2 = Explode(Curve=polyline_5, Recursive=True)  # -> Segments, Vertices
explode_3 = Explode(Curve=polyline_6, Recursive=True)  # -> Segments, Vertices
explode_4 = Explode(Curve=polyline_2, Recursive=True)  # -> Segments, Vertices
explode_5 = Explode(Curve=polyline_3, Recursive=True)  # -> Segments, Vertices
explode_6 = Explode(Curve=polyline_4, Recursive=True)  # -> Segments, Vertices
explode_7 = Explode(Curve=cull_index_3, Recursive=True)  # -> Segments, Vertices
merge_2 = Merge(Data1=explode_4.Segments, Data2=explode_5.Segments)
cluster_2 = Cluster(cross_section_index=cross_section_idx)
entwine = Entwine(
    Branch00=explode_2.Segments,
    Branch01=explode_3.Segments,
    Branch02=merge_2,
    Branch03=explode_6.Segments,
    Branch04=explode_7.Segments,
    FlattenInputs=True)
merge_3 = Merge(
    Data1=ColourSwatch(SwatchColor=RGB(195, 57, 230)),
    Data2=ColourSwatch(SwatchColor=RGB(204, 57, 57)),
    Data3=ColourSwatch(SwatchColor=RGB(102, 237, 237)),
    Data4=ColourSwatch(SwatchColor=RGB(61, 209, 100)))  # -> graft(Result)
panel = Panel("""Top X
Top Y
Diag
Bottom Y
Bottom X""")
create_linear_element_karamba3d = LineElem(
    Line=entwine,
    Colour=merge_3,
    Identifier=graft(panel),
    CrossSection=cluster_2,
    LimitDistance_m=0.005,
    BucklingLengthY_m=-1,
    BucklingLengthZ_m=-1,
    BucklingLengthLT_m=-1,
    Bending=True,
    ToPolylineMaxAngle=0.25,
    ToPolylineTolerance=0.1,
    ToPolylineMaxEdgeLength=0.25,
    New=True,
    Remove=True,
    mode="LineToBeam",
    GuidGeneratorSeed=1161046314)  # -> simplify(Element), Points, Info
panel_2 = Panel("""{0;*}
{1;*}""")
split_tree = SplitTree(Data=create_linear_element_karamba3d.Element, Masks=flatten(panel_2))  # -> flatten(Positive), Negative

# ----
octopus = Octopus(OctopusData_gene=gene_pool, OctopusData_obj=[mass_kg, max_def_cm, height_ratio])

# ---- group: Supports
panel_3 = Panel("""0
-1""")
list_item_2 = ListItem(List=cluster, Index=panel_3, Wrap=True)  # -> flatten(Item)
panel_4 = Panel("""0
1
-2
-1""")
list_item_3 = ListItem(List=list_item_2, Index=flatten(panel_4), Wrap=True)
list_item_4 = ListItem(List=list_item_3, Index=0, Wrap=True)  # -> Item, Item1, Item2, Item3
support_karamba3d = Supp(PosInd=list_item_4.Item3, Ct_kN_m=Vector(0, 0, 0), Cr_kNm_rad=Vector(0, 0, 0), menu=[buttons(on, on, on, off, off, off)])
support_karamba3d_2 = Supp(PosInd=list_item_4.Item1, Ct_kN_m=Vector(0, 0, 0), Cr_kNm_rad=Vector(0, 0, 0), menu=[buttons(on, on, on, off, off, off)])
support_karamba3d_3 = Supp(PosInd=list_item_4.Item2, Ct_kN_m=Vector(0, 0, 0), Cr_kNm_rad=Vector(0, 0, 0), menu=[buttons(on, on, on, off, off, off)])
support_karamba3d_4 = Supp(PosInd=list_item_4.Item, Ct_kN_m=Vector(0, 0, 0), Cr_kNm_rad=Vector(0, 0, 0), menu=[buttons(on, on, on, off, off, off)])
merge_4 = Merge(Data1=support_karamba3d_4, Data2=support_karamba3d_2, Data3=support_karamba3d_3, Data4=support_karamba3d)

# ---- group: Loads
length = Length(Curve=split_tree.Positive)
mass_addition = MassAddition(Input=length)  # -> Result, PartialResults
area = Area(Geometry=scale_nu.Geometry)  # -> Area, Centroid
matr_nr = Panel("00626258")
dm2_to_m2 = Panel("100")
dm_to_m = Panel("10")
cluster_3 = Cluster_3(matrikel_nr=matr_nr)
division_2 = Division(A=area.Area, B=dm2_to_m2)
division_3 = Division(A=mass_addition.Result, B=dm_to_m)
expression = Expression(q=cluster_3, A=division_2, l=division_3, Expression="(q*A)/l")
lineload = Panel(expression)
unit_z_2 = UnitZ(Factor=expr("-x", lineload))
beam_loads_karamba3d = BeamLoads(
    BeamIdentifier=split_tree.Positive,
    LoadCase="LC0",
    ForceVector=unit_z_2,
    TStart=0,
    TEnd=1,
    mode="Block",
    menu=[buttons(off, on, off)])
loads_karamba3d = Loads(Vector=Vector(0, 0, -1), LCase="LC0", mode="Gravity")
merge_5 = Merge(Data1=beam_loads_karamba3d, Data2=loads_karamba3d)  # -> flatten(Result)
panel_5 = Panel(merge_5)

# ----
panel_6 = Panel("""Top Y
Bottom Y
Top X
Bottom X""")
beam_joints_karamba3d = BeamJoints(
    BeamIdentifier=panel_6,
    CtKNMAtStartingNode=Vector(0, 0, 0),
    CrKNmRadAtStartingNode=Vector(0, 0, 0),
    CtKNMAtEndNode=Vector(0, 0, 0),
    CrKNmRadAtEndNode=Vector(0, 0, 0),
    menu=[buttons(off, off, off, on, on, on), buttons(off, off, off, off, on, on)])

# ---- group: Analysis
assemble_model_karamba3d = Assemble(
    Elem=flatten(create_linear_element_karamba3d.Element),
    Support=merge_4,
    Load=merge_5,
    Joint=beam_joints_karamba3d,
    LimitDistance_m=0.005)  # -> Model, Info, Mass_kg, CentreOfGravity, LoadCaseNames
license_karamba3d = License()
panel_7 = Panel(license_karamba3d)
analyse_karamba3d = Analyse(Model=assemble_model_karamba3d.Model)  # -> AnalysedModel, MaximumDisplacement_cm, ResultingForce_kN, ChangeOfElasticEnergy_kNm
panel_8 = Panel(analyse_karamba3d.MaximumDisplacement_cm)
model_view_karamba3d = ModelView(Model=analyse_karamba3d.AnalysedModel)  # -> Model, DeformedMesh, DeformedAxes, DeformedModel, MaximumDeformation
beam_view_karamba3d = BeamView(Model=model_view_karamba3d.Model)  # -> Model, MeshesOfRenderedBeams, DeformedBeamAxes, LegendColours, LegendTags

# ---- group: Goals
max_def_cm = Number(expr("-x", model_view_karamba3d.MaximumDeformation))
mass_kg = Number(expr("-x", assemble_model_karamba3d.Mass_kg))
panel_9 = Panel(mass_kg)
panel_10 = Panel(max_def_cm)

# ==== cluster Cluster

# ---- group: Material/Cross-section library
cross_section_index = ClusterInput()
frischeis_duo_trio_katalog = Panel("""10,6
12,6
14,14
16,6
16,16
16,12
18,12
24,14
20,12
24,16
20,16
20,14""")
text_split = TextSplit(Text=frischeis_duo_trio_katalog, Separators=",")  # -> flatten(Result)
material_selection_karamba3d = MatSelect(menu=[dropdown(1), dropdown(2), dropdown(3)])
dispatch = Dispatch(List=text_split, DispatchPattern=[True, False])  # -> ListA, Breiten
cross_section_karamba3d = CroSec(
    FamilyNameOfCrossSection="DefaultCroSec",
    Material=material_selection_karamba3d,
    Height_cm=dispatch.ListA,
    UpperFlangeWidth_cm=dispatch.Breiten,
    LowerFlangeWidth_cm=dispatch.Breiten,
    mode="Trapezoid")
item = ListItem(List=flatten(cross_section_karamba3d), Index=cross_section_index, Wrap=True)
selected_cross_section = Panel(item)
cross_section = ClusterOutput(item)

# ==== cluster Cluster_2
geometry = ClusterInput()
h_aussen = ClusterInput()
h_innen = ClusterInput()
X = ClusterInput()
Y = ClusterInput()

# ---- group: Projected Reference Plane
unit_z = UnitZ(Factor="12")
project = Project(Geometry=geometry, Plane=unit_z)  # -> Geometry, Transform
multiplication = Multiplication(A=X, B="2")
multiplication_2 = Multiplication(A=Y, B="2")
divide_surface = DivideSurface(Surface=reparameterize(project.Geometry), UCount=multiplication, VCount=multiplication_2)  # -> Points, Normals, simplify(Parameters)
dispatch = Dispatch(List=divide_surface.Points, DispatchPattern=[True, False])  # -> ListA, simplify(ListB)
flip_matrix = FlipMatrix(Data=dispatch.ListB)
dispatch_2 = Dispatch(List=flip_matrix, DispatchPattern=[True, False])  # -> ListA, simplify(ListB)
flip_matrix_2 = FlipMatrix(Data=dispatch_2.ListB)

# ---- group: Calculate Point Offsets
tree_statistics = TreeStatistics(Tree=flip_matrix_2)  # -> Paths, Length, Count
steps = Number(expr("(x/4)-1", tree_statistics.Count))
range = Range(Domain=steps, Steps=steps)
expression = Expression(
    h_aussen=h_aussen,
    h_innen=h_innen,
    steps=steps,
    seq=range,
    Expression="(h_aussen+5) - ((h_aussen - h_innen+5)/steps) * seq")
expression_2 = Expression(Y=Y, h_aussen=h_aussen, h_innen=h_innen, Expression="(((h_aussen+3-h_innen)*0.75)/(y*0.5)) * -1")
list_length = ListLength(List=expression)  # -> flatten(Length)
range_2 = Range(Domain="4", Steps=expr("x-1", list_length))
addition = Addition(A=range_2, B=expression)
merge = Merge(Data1=reverse(addition), Data2=expression)
series = Series(Start=graft(merge), Step=expression_2, Count=expr("x/2", Y))
merge_2 = Merge(Data1=series, Data2=reverse(series))
negative = Negative(Value=merge_2)
unit_z_2 = UnitZ(Factor=negative)  # -> simplify(UnitVector)
path_mapper = PathMapper(unit_z_2, source="{A}", target="{2*path_count + -path_index-1}")
merge_3 = Merge(Data1=unit_z_2, Data2=path_mapper)
panel = Panel(merge_3)

# ----
addition_2 = Addition(A=flip_matrix_2, B=merge_3)
untergurt_points = ClusterOutput(addition_2)

# ==== cluster Cluster_3
matrikel_nr = ClusterInput()

chars = Characters(Text=matrikel_nr)  # -> Result, Unicode
num = Number(chars.Result)
avr = Average(Input=num)
remap = RemapNumbers(Value=avr, Source=Domain(0, 9), Target=Domain(1.2, 2.4))  # -> Mapped, Clipped
roundd = RoundToDecimalPlace(NumberX=remap.Mapped, DecimalPlace=2, RoundType=0)  # -> Rounded, Difference
permanent_live_base_load = Panel("2")
panel = Panel(roundd.Rounded)
multiplication = Multiplication(A=permanent_live_base_load, B=panel)

surface_load = ClusterOutput(multiplication)
